# Grasshopper definition Sapata_Esferica.gh (Grasshopper 1.0.7)

alturapescoco = Slider(17, range=0..100)
paredetubo = Slider(1.99, range=0..6)
diametrobase = Slider(28.9, range=3..150)
dom = ConstructDomain(DomainStart=expr("-x/2", diametrobase), DomainEnd=expr("x/2", diametrobase))
cir = Circle(Plane=PlaneXY(0, 0, 0), Radius=expr("x/2", diametrobase))
sph = Sphere(Base=PlaneXY(0, 0, 0), Radius=expr("x/2", diametrobase))
rectangle = Rectangle(Plane=PlaneXY(0, 0, 0), XSize=dom, YSize=dom, Radius=0)  # -> Rectangle, Length
offset = OffsetCurve(Curve=cir, Distance=expr("-x", paredetubo), Corners=1)
Z = UnitZ(Factor=diametrobase)
extr = Extrude(Base=rectangle.Rectangle, Direction=Z)
cap = CapHoles(Brep=extr)
espessuraaneistecnica = Slider(1.5, range=0..6)
area = Area(Geometry=cir)  # -> Area, Centroid
offset_2 = OffsetCurve(Curve=offset, Distance=expr("-x", espessuraaneistecnica), Corners=1)
sdiff = SolidDifference(BrepsA=sph, BrepsB=cap)
Z_2 = UnitZ(Factor=alturapescoco)
move = Move(Geometry=area.Centroid, Motion=Z_2)  # -> Geometry, Transform
Z_3 = UnitZ(Factor=alturapescoco)
extr_2 = Extrude(Base=[offset_2, offset], Direction=Z_3)  # -> flatten(Extrusion)
ln = Line(StartPoint=area.Centroid, EndPoint=move.Geometry)
divisoesaneistecnica = Slider(6, range=0..10)
divide = DivideCurve(Curve=ln, Count=divisoesaneistecnica, Kinks=False)  # -> Points, Tangents, Parameters
cap_2 = CapHoles(Brep=extr_2)
panel = Panel(extr_2)
tamanhopontostecnico = Slider(2, range=0..10)
item = ListItem(List=cap_2, Index=0, Wrap=True)  # -> Item, Item1
points = PointList(Points=divide.Points, Size=tamanhopontostecnico)
item_2 = ListItem(List=divide.Points, Index=0, Wrap=True)  # -> Item, Item1, Item2, Item3, Item4, Item5
sdiff_2 = SolidDifference(BrepsA=item.Item, BrepsB=item.Item1)
multiplication = Multiplication(A=paredetubo, B=2)
subtraction = Subtraction(A=diametrobase, B=multiplication)
cir_2 = Circle(Plane=[item_2.Item1, item_2.Item3, item_2.Item5], Radius=expr("x/2", subtraction))
pipe = Pipe(Curve=cir_2, Radius=1, Caps=0)  # -> flatten(Pipe)
export_3mf = SolidUnion(Breps=[sdiff, sdiff_2, pipe])
