# Grasshopper definition Sapata_Interna_Tubo-Oblongo.gh (Grasshopper 1.0.7)
# plug-ins: Pufferfish

number_slider = Slider(3, range=0..10)
number_slider_2 = Slider(53, range=0..100)
number_slider_3 = Slider(53, range=0..100)

bnd = Bounds(Numbers=[number_slider_2, number_slider_3])
dedomain = DeconstructDomain(Domain=bnd)  # -> Start, End
rectangle = Rectangle(Plane=PlaneXY(0, 0, 0), XSize=number_slider_2, YSize=number_slider_3, Radius=expr("x/2", dedomain.Start))  # -> Rectangle, Length

offcrv = OffsetCurve(
    Curve=rectangle.Rectangle,
    Plane=PlaneXY(0, 0, 0),
    Distance=expr("-x", Slider(2, range=0..10)),
    BothSides=0,
    Kinks=0,
    CapType=1)
Z = UnitZ(Factor=number_slider)
move = Move(Geometry=offcrv, Motion=Z)  # -> Geometry, Transform
Z_2 = UnitZ(Factor=Slider(20.5, range=0..30))
extr = Extrude(Base=move.Geometry, Direction=Z_2)
cap = CapHoles(Brep=extr)

offcrv_2 = OffsetCurve(Curve=offcrv, Plane=PlaneXY(0, 0, 0), Distance=Slider(0.5, range=0..1), BothSides=0, Kinks=0, CapType=1)
number_slider_4 = Slider(1, range=0..1)
Z_3 = UnitZ(Factor=number_slider_4)
extr_2 = Extrude(Base=offcrv_2, Direction=Z_3)
cap_2 = CapHoles(Brep=extr_2)
panel = Panel("""1
2""")
filedge = FilletEdge(Shape=cap_2, Blend=0, Metric=0, Edges=panel, Radii=expr("x/2", number_slider_4))
area = Area(Geometry=filedge)  # -> Area, Centroid
cluster = Cluster(B=extr)
move2pt = MoveToPoint(Geometry=filedge, PointA=area.Centroid, PointB=cluster)  # -> Moved, Vector, Transform

offcrv_3 = OffsetCurve(
    Curve=move.Geometry,
    Plane=PlaneXY(0, 0, 0),
    Distance=expr("-x", Slider(2, range=0..10)),
    BothSides=0,
    Kinks=0,
    CapType=1)
extr_3 = Extrude(Base=offcrv_3, Direction=Z_2)
cap_3 = CapHoles(Brep=extr_3)

extr_4 = Extrude(Base=rectangle.Rectangle, Direction=Z)
cap_4 = CapHoles(Brep=extr_4)
filedge_2 = FilletEdge(Shape=cap_4, Blend=0, Metric=0, Edges="2", Radii=expr("x-0.5", number_slider))

sdiff = SolidDifference(BrepsA=[cap, move2pt.Moved], BrepsB=cap_3)
sunion = SolidUnion(Breps=flatten([filedge_2, sdiff]))

# ==== cluster Cluster
B = ClusterInput()
debrep = DeconstructBrep(Brep=B)  # -> Faces, Edges, Vertices
item = ListItem(List=debrep.Edges, Index=0, Wrap=True)  # -> Item, Item1, Item2
area = Area(Geometry=[item.Item1, item.Item2])  # -> Area, Centroid
item_2 = ListItem(List=area.Centroid, Index=0, Wrap=True)  # -> Item, Item1, Item2
ln = Line(StartPoint=item_2.Item, EndPoint=item_2.Item1)
curvepoint = PointOnCurve(ln, parameter=0.5)
scale = Scale(Geometry=ln, Center=curvepoint, Factor=Slider(0.7, range=0..1))  # -> Geometry, Transform
divide = DivideCurve(Curve=scale.Geometry, Count=Slider(3, range=0..10), Kinks=False)  # -> Points, Tangents, Parameters
P = ClusterOutput(divide.Points)
