# Grasshopper definition Sapata_Interna_Tubo-Quadrado.gh (Grasshopper 1.0.7)
# plug-ins: Pufferfish

parede_tubo = Slider(4.6, range=0..10)
altura_pescoco = Slider(23.1, range=0..30)
raio_base = Slider(3, range=0..10)
altura_base = Slider(6.2, range=0..10)
interferencia = Slider(0.5, range=0..1)

number_slider = Slider(1, range=0..1)
Z = UnitZ(Factor=number_slider)
panel = Panel("""1
2""")

rectangle = Rectangle(Plane=PlaneXY(0, 0, 0), XSize=Slider(50, range=0..100), YSize=Slider(50, range=0..100), Radius=raio_base)  # -> Rectangle, Length

offcrv = OffsetCurve(Curve=rectangle.Rectangle, Plane=PlaneXY(0, 0, 0), Distance=expr("-x", parede_tubo), BothSides=0, Kinks=0, CapType=1)
Z_2 = UnitZ(Factor=altura_base)
move = Move(Geometry=offcrv, Motion=Z_2)  # -> Geometry, Transform
Z_3 = UnitZ(Factor=altura_pescoco)
extr = Extrude(Base=move.Geometry, Direction=Z_3)
cap = CapHoles(Brep=extr)

debrep = DeconstructBrep(Brep=cap)  # -> Faces, Edges, Vertices

parede_pescoço = Slider(1.2, range=0..10)
offcrv_2 = OffsetCurve(Curve=move.Geometry, Plane=PlaneXY(0, 0, 0), Distance=expr("-x", parede_pescoço), BothSides=0, Kinks=0, CapType=1)
extr_2 = Extrude(Base=offcrv_2, Direction=Z_3)
cap_2 = CapHoles(Brep=extr_2)

item = ListItem(List=debrep.Faces, Index=0, Wrap=True)  # -> Item, Item1, Item2, Item3, Item4, Item5

extr_3 = Extrude(Base=rectangle.Rectangle, Direction=Z_2)
cap_3 = CapHoles(Brep=extr_3)
filedge = FilletEdge(Shape=cap_3, Blend=0, Metric=0, Edges="2", Radii=expr("x-0.5", raio_base))

area = Area(Geometry=[item.Item5, item.Item4])  # -> Area, Centroid
item_2 = ListItem(List=area.Centroid, Index=0, Wrap=True)  # -> Item, Item1, Item2
ln = Line(StartPoint=item_2.Item, EndPoint=item_2.Item1)
curvepoint = PointOnCurve(ln, parameter=0.5)
scale = Scale(Geometry=ln, Center=curvepoint, Factor=Slider(0.7, range=0..1))  # -> Geometry, Transform
divide = DivideCurve(Curve=scale.Geometry, Count=Slider(3, range=0..10), Kinks=False)  # -> Points, Tangents, Parameters

offcrv_3 = OffsetCurve(Curve=offcrv, Plane=PlaneXY(0, 0, 0), Distance=interferencia, BothSides=0, Kinks=0, CapType=1)
extr_4 = Extrude(Base=offcrv_3, Direction=Z)
cap_4 = CapHoles(Brep=extr_4)
filedge_2 = FilletEdge(Shape=cap_4, Blend=0, Metric=0, Edges=panel, Radii=expr("x/2", number_slider))
area_2 = Area(Geometry=filedge_2)  # -> Area, Centroid
move2pt = MoveToPoint(Geometry=filedge_2, PointA=area_2.Centroid, PointB=divide.Points)  # -> Moved, Vector, Transform

sdiff = SolidDifference(BrepsA=[cap, move2pt.Moved], BrepsB=cap_2)
sunion = SolidUnion(Breps=flatten([filedge, sdiff]))
