# Grasshopper definition Sapata_Interna_Tubo-Redondo.gh (Grasshopper 1.0.7)
# plug-ins: Pufferfish

parede_tubo = Slider(1.2, range=0..10)
altura_pescoco = Slider(18, range=0..30)
altura_base = Slider(3, range=0..10)
diametro = Slider(38, range=0..150)
interferencia = Slider(0.5, range=0..1)

bnd = Bounds(Numbers=diametro)
dedomain = DeconstructDomain(Domain=bnd)  # -> Start, End
rectangle = Rectangle(Plane=PlaneXY(0, 0, 0), XSize=diametro, YSize=diametro, Radius=expr("x/2", dedomain.Start))  # -> Rectangle, Length

offcrv = OffsetCurve(Curve=rectangle.Rectangle, Plane=PlaneXY(0, 0, 0), Distance=expr("-x", parede_tubo), BothSides=0, Kinks=0, CapType=1)
Z = UnitZ(Factor=altura_base)
move = Move(Geometry=offcrv, Motion=Z)  # -> Geometry, Transform
Z_2 = UnitZ(Factor=altura_pescoco)
extr = Extrude(Base=move.Geometry, Direction=Z_2)
cap = CapHoles(Brep=extr)

offcrv_2 = OffsetCurve(Curve=offcrv, Plane=PlaneXY(0, 0, 0), Distance=interferencia, BothSides=0, Kinks=0, CapType=1)
number_slider = Slider(1, range=0..1)
Z_3 = UnitZ(Factor=number_slider)
extr_2 = Extrude(Base=offcrv_2, Direction=Z_3)
cap_2 = CapHoles(Brep=extr_2)
panel = Panel("""1
2""")
filedge = FilletEdge(Shape=cap_2, Blend=0, Metric=0, Edges=panel, Radii=expr("x/2", number_slider))
area = Area(Geometry=filedge)  # -> Area, Centroid
cluster = Cluster(B=extr)
move2pt = MoveToPoint(Geometry=filedge, PointA=area.Centroid, PointB=cluster)  # -> Moved, Vector, Transform

parede_pescoço = Slider(1.2, range=0..10)
offcrv_3 = OffsetCurve(Curve=move.Geometry, Plane=PlaneXY(0, 0, 0), Distance=expr("-x", parede_pescoço), BothSides=0, Kinks=0, CapType=1)
extr_3 = Extrude(Base=offcrv_3, Direction=Z_2)
cap_3 = CapHoles(Brep=extr_3)

extr_4 = Extrude(Base=rectangle.Rectangle, Direction=Z)
cap_4 = CapHoles(Brep=extr_4)
filedge_2 = FilletEdge(Shape=cap_4, Blend=0, Metric=0, Edges="2", Radii=expr("x-0.5", altura_base))

sdiff = SolidDifference(BrepsA=[cap, move2pt.Moved], BrepsB=cap_3)
sunion = SolidUnion(Breps=flatten([filedge_2, sdiff]))

panel_2 = Panel(sunion)

# ==== cluster Cluster
B = ClusterInput()
debrep = DeconstructBrep(Brep=B)  # -> Faces, Edges, Vertices
item = ListItem(List=debrep.Edges, Index=0, Wrap=True)  # -> Item, Item1, Item2
area = Area(Geometry=[item.Item1, item.Item2])  # -> Area, Centroid
item_2 = ListItem(List=area.Centroid, Index=0, Wrap=True)  # -> Item, Item1, Item2
ln = Line(StartPoint=item_2.Item, EndPoint=item_2.Item1)
curvepoint = PointOnCurve(ln, parameter=0.5)
scale = Scale(Geometry=ln, Center=curvepoint, Factor=Slider(0.7, range=0..1))  # -> Geometry, Transform
divide = DivideCurve(Curve=scale.Geometry, Count=Slider(3, range=0..10), Kinks=False)  # -> Points, Tangents, Parameters
P = ClusterOutput(divide.Points)
