# Grasshopper definition Sapata_Lisa_Redonda-com Haste.gh (Grasshopper 1.0.7)

diametro = Slider(24, range=0..100)
diametro_haste = Slider(5, range=0..100)
altura_base = Slider(5, range=0..10)
altura_haste = Slider(7, range=0..100)
cyl = Cylinder(Base=PlaneXY(0, 0, 0), Radius=expr("x/2", diametro), Length=altura_base)
addition = Addition(A=altura_base, B=altura_haste)
cyl_2 = Cylinder(Base=PlaneXY(0, 0, 0), Radius=expr("x/2", diametro_haste), Length=addition)
cap = CapHoles(Brep=cyl)
filedge = FilletEdge(Shape=cap, Blend=0, Metric=0, Edges="0", Radii=altura_base)
sunion = SolidUnion(Breps=[filedge, cyl_2])
