# Grasshopper definition Sapata_Lisa_Redonda-com parafuso.gh (Grasshopper 1.0.7)

# ---- group: Redondo com parafuso
diam_parafuso = Slider(3, range=0..10)
altura_base = Slider(4, range=0..10)
diametro = Slider(28, range=0..100)
cyl = Cylinder(Base=PlaneXY(0, 0, 0), Radius=expr("x/2", diametro), Length=altura_base)
cyl_2 = Cylinder(Base=PlaneXY(0, 0, 0), Radius=diam_parafuso, Length=altura_base)
debrep = DeconstructBrep(Brep=cyl_2)  # -> Faces, Edges, Vertices
debrep_2 = DeconstructBrep(Brep=cyl)  # -> Faces, Edges, Vertices
item = ListItem(List=debrep_2.Edges, Index=0, Wrap=True)  # -> Item, Item1, Item2
item_2 = ListItem(List=debrep.Edges, Index=0, Wrap=True)  # -> Item, Item1, Item2
loft = Loft(
    Curves=[item.Item, item_2.Item],
    Options={Adjust=False, Closed=False, LoftEnds=0, LoftSimp=0, LoftType=0, Rebuild=10, Refit=0.01})
loft_2 = Loft(
    Curves=[item_2.Item2, item.Item2],
    Options={Adjust=False, Closed=False, LoftEnds=0, LoftSimp=0, LoftType=0, Rebuild=10, Refit=0.01})
division = Division(A=diam_parafuso, B=2)
join = BrepJoin(Breps=flatten([loft, loft_2, cyl, cyl_2]))  # -> Breps, Closed
filedge = FilletEdge(Shape=join.Breps, Blend=1, Metric=0, Edges="3", Radii=division)
filedge_2 = FilletEdge(Shape=filedge, Blend=0, Metric=0, Edges="0", Radii=altura_base)
