# Grasshopper definition Sapata_PinoInserido.gh (Grasshopper 1.0.7)

diametro = Slider(5.7, range=0..15)
cir = Circle(Plane=PlaneXY(0, 0, 0), Radius=expr("x/2", diametro))
altura = Slider(5, range=0..20)
Z = UnitZ(Factor=altura)
extr = Extrude(Base=cir, Direction=Z)
cap = CapHoles(Brep=extr)
panel = Panel("""1
2""")
filedge = FilletEdge(Shape=cap, Blend=0, Metric=0, Edges=panel, Radii=Slider(0.5, range=0..2))
