# Grasshopper definition Sapata_U_ComHaste.gh (Grasshopper 1.0.7)

diametro = Slider(16.8, range=0..30)
X = UnitX(Factor=1)
pt = Point(Point(0, 0, 0))
espessura = Slider(1.4, range=0..3)
circle = CircleCNR(Center=pt, Normal=X, Radius=expr("x/2", diametro))
offset = OffsetCurve(Curve=circle, Distance=espessura, Corners=1)
comprimento = Slider(36.2, range=0..100)
X_2 = UnitX(Factor=comprimento)
extr = Extrude(Base=[circle, offset], Direction=X_2)
item = ListItem(List=flatten(extr), Index=0, Wrap=True)
cap = CapHoles(Brep=extr)  # -> flatten(Brep)
debrep = DeconstructBrep(Brep=item)  # -> Faces, Edges, Vertices
area = Area(Geometry=debrep.Faces)  # -> Area, Centroid
item_2 = ListItem(List=cap, Index=0, Wrap=True)  # -> Item, Item1
pt_2 = Point(area.Centroid)
sdiff = SolidDifference(BrepsA=item_2.Item1, BrepsB=item_2.Item)
cir = Circle(Plane=pt_2, Radius=Slider(2.5, range=0..3))
bbox = BoundingBox(Content=sdiff, Plane=PlaneXY(0, 0, 0))  # -> Box, Box_2
debrep_2 = DeconstructBrep(Brep=bbox.Box)  # -> Faces, Edges, Vertices
Z = UnitZ(Factor=diametro)
extr_2 = Extrude(Base=cir, Direction=expr("-x/2", Z))
item_3 = ListItem(List=debrep_2.Edges, Index=Slider(8, range=0..10), Wrap=True)  # -> Item, Item1
item_4 = ListItem(List=debrep_2.Vertices, Index=Slider(4, range=0..10), Wrap=True)  # -> flatten(Item), flatten(Item1)
cap_2 = CapHoles(Brep=extr_2)
curvepoint = PointOnCurve([item_3.Item, item_3.Item1], parameter=0.5)
pt_3 = Point(item_4.Item)
ln = Line(StartPoint=item_4.Item, EndPoint=item_4.Item1)  # -> flatten(Line)
curvepoint_2 = PointOnCurve(ln, parameter=0.5)
split = SplitList(List=curvepoint, Index="1")  # -> flatten(ListA), flatten(ListB)
panel = Panel([split.ListA, pt_3, curvepoint_2, item_4.Item1, split.ListB])
nurbs = NurbsCurve(Vertices=panel, Degree="3", Periodic=False)  # -> Curve, Length, Domain
debox = DeconstructBox(Box=bbox.Box)  # -> Plane, X, Y, Z
num = Number(debox.Y)
Y = UnitY(Factor=num)
extr_3 = Extrude(Base=nurbs.Curve, Direction=Y)
offset_2 = OffsetSurface(Surface=extr_3, Distance="-10", Retrim=True)
debrep_3 = DeconstructBrep(Brep=[extr_3, offset_2])  # -> Faces, Edges, Vertices
item_5 = ListItem(List=debrep_3.Edges, Index=0, Wrap=True)  # -> flatten(Item), flatten(Item1), flatten(Item2), flatten(Item3), flatten(Item4), flatten(Item5)
loft = Loft(Curves=item_5.Item, Options={Adjust=False, Closed=False, LoftEnds=0, LoftSimp=0, LoftType=0, Rebuild=10, Refit=0.01})
loft_2 = Loft(Curves=item_5.Item1, Options={Adjust=False, Closed=False, LoftEnds=0, LoftSimp=0, LoftType=0, Rebuild=10, Refit=0.01})
loft_3 = Loft(Curves=item_5.Item2, Options={Adjust=False, Closed=False, LoftEnds=0, LoftSimp=0, LoftType=0, Rebuild=10, Refit=0.01})
loft_4 = Loft(Curves=item_5.Item3, Options={Adjust=False, Closed=False, LoftEnds=0, LoftSimp=0, LoftType=0, Rebuild=10, Refit=0.01})
join = BrepJoin(Breps=flatten([loft, loft_2, loft_3, loft_4, extr_3, offset_2]))  # -> Breps, Closed
Z_2 = UnitZ(Factor=espessura)
move = Move(Geometry=join.Breps, Motion=expr("-x*2", Z_2))  # -> Geometry, Transform
sdiff_2 = SolidDifference(BrepsA=sdiff, BrepsB=move.Geometry)
sunion = SolidUnion(Breps=flatten([sdiff_2, cap_2]))
